# Grasshopper definition 3D_Visualization.gh (Grasshopper 1.0.7)
# plug-ins: Heron

panel = Panel("设置原点")
panel_2 = Panel("下载的文件")
panel_3 = Panel("边界长方形")
path = FilePath("H:\UCL Master\24.12.7\工作簿1.csv")
path_2 = FilePath("H:\UCL Master\24.12.7\map.osm")
path_3 = FilePath("C:\Users\GONG\Desktop\Download_2624774\england-laz-2021_5734990\tr\tr0090_p_12461_20211023_20211023.laz")
file = ReadFile(File=path, PerLineParse=True)
geo = Geometry(<curve referenced from the Rhino model>)
importlaz = ImportLAZ(LASLAZPointFile=path_3)  # -> Info, Points, Colors, PointCloudSRS
importosm = ImportOSM(Boundary=geo, OSMDataLocation=path_2, Clipped=True)  # -> Extents, Fields, Values, FeatureGeometry, Buildings
split = TextSplit(Text="51.52288553916184, -0.00433437565918423", Separators=",")
panel_4 = Panel(file)
cull_i = CullIndex(List=file, Indices=Slider(0, range=0..100), Wrap=True)
panel_5 = Panel(importlaz.Points)
item = ListItem(List=split, Index=0, Wrap=True)  # -> Item, Item1
flatten = FlattenTree(Tree=importosm.FeatureGeometry, Path="{0}")
panel_6 = Panel(cull_i)
seteap = SetEarthAnchorPoint(SetEAP=Toggle(True), Latitude=item.Item, Longitude=item.Item1)
panel_7 = Panel(importosm.FeatureGeometry)
split_2 = TextSplit(Text=cull_i, Separators=",")
geo_2 = Geometry(flatten)
item_2 = ListItem(List=split_2, Index=Slider(1, range=0..10), Wrap=True)  # -> Item, Item1
panel_8 = Panel(split_2)
ddtoxy = DecimalDegreesToXY(Latitude=item_2.Item, Longitude=item_2.Item1)  # -> XyPoint, Transform
panel_9 = Panel(ddtoxy.XyPoint)
flatten_2 = FlattenTree(Tree=ddtoxy.XyPoint, Path="{0}")

item_3 = ListItem(List=split_2, Index=Slider(7, range=0..10), Wrap=True)  # -> flatten(Item)
panel_10 = Panel(item_3)
subtraction = Subtraction(A=item_3, B=Slider(60, range=0..1000))
division = Division(A=subtraction, B=Slider(0.3, range=0..1))
Z = UnitZ(Factor=division)
move = Move(Geometry=flatten_2, Motion=Z)  # -> Geometry, Transform
ln = Line(StartPoint=flatten_2, EndPoint=move.Geometry)

item_4 = ListItem(List=split_2, Index=Slider(6, range=0..10), Wrap=True)  # -> flatten(Item)
panel_11 = Panel(item_4)
subtraction_2 = Subtraction(A=item_4, B=Slider(212, range=0..1000))
division_2 = Division(A=subtraction_2, B=Slider(0.3, range=0..1))
Z_2 = UnitZ(Factor=division_2)
move_2 = Move(Geometry=flatten_2, Motion=Z_2)  # -> Geometry, Transform
ln_2 = Line(StartPoint=flatten_2, EndPoint=move_2.Geometry)

pipe = Pipe(Curve=ln, Radius=Slider(3, range=0..10), Caps=Slider(1, range=0..1))
pipe_2 = Pipe(Curve=ln_2, Radius=Slider(3, range=0..10), Caps=Slider(1, range=0..1))
area = Area(Geometry=pipe)  # -> Area, Centroid
area_2 = Area(Geometry=pipe_2)  # -> Area, Centroid
pdecon = Deconstruct(Point=area.Centroid)  # -> XComponent, YComponent, flatten(ZComponent)
pdecon_2 = Deconstruct(Point=area_2.Centroid)  # -> XComponent, YComponent, flatten(ZComponent)
flatten_3 = FlattenTree(Tree=pipe, Path="{0}")
bnd = Bounds(Numbers=pdecon.ZComponent)
flatten_4 = FlattenTree(Tree=pipe_2, Path="{0}")
bnd_2 = Bounds(Numbers=pdecon_2.ZComponent)
panel_12 = Panel(flatten_3)
dedomain = DeconstructDomain(Domain=bnd)  # -> Start, End
panel_13 = Panel(flatten_4)
dedomain_2 = DeconstructDomain(Domain=bnd_2)  # -> Start, End
gradient = Gradient(
    LowerLimit=dedomain.Start,
    UpperLimit=dedomain.End,
    Parameter=pdecon.ZComponent,
    stops=[0: RGB(78, 78, 172), 0.245: RGB(255, 255, 0), 0.673: RGB(255, 128, 128), 1: RGB(255, 0, 0)])
gradient_2 = Gradient(
    LowerLimit=dedomain_2.Start,
    UpperLimit=dedomain_2.End,
    Parameter=pdecon_2.ZComponent,
    stops=[0: RGB(78, 78, 172), 0.494: RGB(255, 255, 0), 0.862: RGB(255, 128, 128), 1: RGB(255, 0, 0)])
preview = CustomPreview(Geometry=flatten_3, Material=gradient)
preview_2 = CustomPreview(Geometry=flatten_4, Material=gradient_2)
