# Grasshopper definition Different types of photos.gh (Grasshopper 1.0.7)
# plug-ins: Heron

area = Area(Geometry=<missing>)  # -> Area, Centroid
panel = Panel("Sky")
panel_2 = Panel("Sunset")
panel_3 = Panel("Cloud")
panel_4 = Panel("River")
path = FilePath("H:\UCL Master\Skill Submission\Skills Module 3 - DATA MINING THE CITY\Scrapped Data\flickr_photos_sky.csv")
path_2 = FilePath("H:\UCL Master\Skill Submission\Skills Module 3 - DATA MINING THE CITY\Scrapped Data\flickr_photos_sunset.csv")
path_3 = FilePath("H:\UCL Master\Skill Submission\Skills Module 3 - DATA MINING THE CITY\Scrapped Data\flickr_photos_cloud.csv")
path_4 = FilePath("H:\UCL Master\Skill Submission\Skills Module 3 - DATA MINING THE CITY\Scrapped Data\flickr_photos_river.csv")
file = ReadFile(File=path, PerLineParse=True)
file_2 = ReadFile(File=path_2, PerLineParse=True)
file_3 = ReadFile(File=path_3, PerLineParse=True)
file_4 = ReadFile(File=path_4, PerLineParse=True)
cull_i = CullIndex(List=file, Indices="0", Wrap=True)
cull_i_2 = CullIndex(List=file_2, Indices="0", Wrap=True)
cull_i_3 = CullIndex(List=file_3, Indices="0", Wrap=True)
cull_i_4 = CullIndex(List=file_4, Indices="0", Wrap=True)
split = TextSplit(Text=cull_i, Separators=",")
split_2 = TextSplit(Text=cull_i_2, Separators=",")
split_3 = TextSplit(Text=cull_i_3, Separators=",")
split_4 = TextSplit(Text=cull_i_4, Separators=",")
panel_5 = Panel(split)
panel_6 = Panel(split_2)
panel_7 = Panel(split_3)
panel_8 = Panel(split_4)
item = ListItem(List=split, Index="0", Wrap=True)  # -> Item, Item1
item_2 = ListItem(List=split_2, Index="0", Wrap=True)  # -> Item, Item1
item_3 = ListItem(List=split_3, Index="0", Wrap=True)  # -> Item, Item1
item_4 = ListItem(List=split_4, Index="0", Wrap=True)  # -> Item, Item1
panel_9 = Panel(item.Item1)
panel_10 = Panel(item.Item)
panel_11 = Panel(item_2.Item1)
panel_12 = Panel(item_2.Item)
panel_13 = Panel(item_3.Item1)
panel_14 = Panel(item_3.Item)
panel_15 = Panel(item_4.Item1)
panel_16 = Panel(item_4.Item)
ddtoxy = DecimalDegreesToXY(Latitude=item.Item, Longitude=item.Item1)  # -> XyPoint, Transform
ddtoxy_2 = DecimalDegreesToXY(Latitude=item_2.Item, Longitude=item_2.Item1)  # -> XyPoint, Transform
ddtoxy_3 = DecimalDegreesToXY(Latitude=item_3.Item, Longitude=item_3.Item1)  # -> XyPoint, Transform
ddtoxy_4 = DecimalDegreesToXY(Latitude=item_4.Item, Longitude=item_4.Item1)  # -> XyPoint, Transform
