# Grasshopper definition Views and Times.gh (Grasshopper 1.0.7)
# plug-ins: Heron

area = Area(Geometry=<missing>)  # -> Area, Centroid
panel = Panel("cloud")
panel_2 = Panel("sky")
path = FilePath("H:\UCL Master\Skill Submission\Skills Module 3 - DATA MINING THE CITY\Scrapped Data\flickr_photos_cloud.csv")
path_2 = FilePath("H:\UCL Master\Skill Submission\Skills Module 3 - DATA MINING THE CITY\Scrapped Data\flickr_photos_sky.csv")
file = ReadFile(File=path, PerLineParse=True)
file_2 = ReadFile(File=path_2, PerLineParse=True)
panel_3 = Panel(file)
panel_4 = Panel(file_2)
cull_i = CullIndex(List=file, Indices="0", Wrap=True)
cull_i_2 = CullIndex(List=file_2, Indices="0", Wrap=True)
split = TextSplit(Text=cull_i, Separators=",")
panel_5 = Panel(split)
split_2 = TextSplit(Text=cull_i_2, Separators=",")
panel_6 = Panel(split_2)
item = ListItem(List=split, Index="0", Wrap=True)  # -> Item, Item1
item_2 = ListItem(List=split_2, Index="0", Wrap=True)  # -> Item, Item1

item_3 = ListItem(List=split, Index="3", Wrap=True)  # -> Item, Item1
panel_7 = Panel(item_3.Item)

item_4 = ListItem(List=split_2, Index="3", Wrap=True)  # -> Item, Item1
panel_8 = Panel(item_4.Item)

panel_9 = Panel(item.Item)
item_5 = ListItem(List=split, Index="3", Wrap=True)  # -> Item, Item1
panel_10 = Panel(item_5.Item)
panel_11 = Panel(item_2.Item)
item_6 = ListItem(List=split_2, Index="3", Wrap=True)  # -> Item, Item1
panel_12 = Panel(item_6.Item)
panel_13 = Panel(item.Item1)
panel_14 = Panel(item_2.Item1)
ddtoxy = DecimalDegreesToXY(Latitude=item.Item, Longitude=item.Item1)  # -> XyPoint, Transform
ddtoxy_2 = DecimalDegreesToXY(Latitude=item_2.Item, Longitude=item_2.Item1)  # -> XyPoint, Transform
dom = ConstructDomain(DomainStart=Slider(0, range=0..1000), DomainEnd=Slider(455, range=0..1000))
dom_2 = ConstructDomain(DomainStart=Slider(0, range=0..1000), DomainEnd=Slider(455, range=0..1000))
dom_3 = ConstructDomain(DomainStart=Slider(0, range=0..1000), DomainEnd=Slider(30, range=0..1000))
panel_15 = Panel(ddtoxy.XyPoint)
dom_4 = ConstructDomain(DomainStart=Slider(0, range=0..1000), DomainEnd=Slider(30, range=0..1000))
panel_16 = Panel(ddtoxy_2.XyPoint)
remap = RemapNumbers(Value=item_3.Item, Source=dom, Target=dom_3)  # -> Mapped, Clipped
remap_2 = RemapNumbers(Value=item_4.Item, Source=dom_2, Target=dom_4)  # -> Mapped, Clipped
dom_5 = ConstructDomain(DomainStart=Slider(46, range=0..1000), DomainEnd=Slider(413, range=0..1000))
dom_6 = ConstructDomain(DomainStart=Slider(46, range=0..1000), DomainEnd=Slider(413, range=0..1000))
dom_7 = ConstructDomain(DomainStart=Slider(156, range=0..1000), DomainEnd=Slider(193, range=0..1000))
dom_8 = ConstructDomain(DomainStart=Slider(156, range=0..1000), DomainEnd=Slider(193, range=0..1000))
unit_z = UnitZ(Factor=remap.Mapped)
unit_z_2 = UnitZ(Factor=remap_2.Mapped)
remap_3 = RemapNumbers(Value=item_5.Item, Source=dom_5, Target=dom_7)  # -> Mapped, Clipped
remap_4 = RemapNumbers(Value=item_6.Item, Source=dom_6, Target=dom_8)  # -> Mapped, Clipped
panel_17 = Panel(remap_3.Mapped)
panel_18 = Panel(remap_4.Mapped)
unit_z_3 = UnitZ(Factor=remap_3.Mapped)
move = Move(Geometry=ddtoxy.XyPoint, Motion=unit_z)  # -> Geometry, Transform
unit_z_4 = UnitZ(Factor=remap_4.Mapped)
move_2 = Move(Geometry=ddtoxy_2.XyPoint, Motion=unit_z_2)  # -> Geometry, Transform
delaunay_mesh = DelaunayMesh(Points=flatten(move.Geometry), Plane=PlaneXY(0, 0, 0))
delaunay_mesh_2 = DelaunayMesh(Points=flatten(move_2.Geometry), Plane=PlaneXY(0, 0, 0))
move_3 = Move(Geometry=ddtoxy_2.XyPoint, Motion=unit_z_4)  # -> Geometry, Transform
mesh_edges = MeshEdges(Mesh=delaunay_mesh)  # -> NakedEdges, InteriorEdges, NonManifoldEdges
mesh_edges_2 = MeshEdges(Mesh=delaunay_mesh_2)  # -> NakedEdges, InteriorEdges, NonManifoldEdges
line = Line(StartPoint=ddtoxy_2.XyPoint, EndPoint=move_3.Geometry)
line_2 = Line(StartPoint=ddtoxy.XyPoint, EndPoint=move.Geometry)
move_4 = Move(Geometry=ddtoxy.XyPoint, Motion=unit_z_3)  # -> Geometry, Transform
line_3 = Line(StartPoint=ddtoxy.XyPoint, EndPoint=move_4.Geometry)
line_4 = Line(StartPoint=ddtoxy_2.XyPoint, EndPoint=move_2.Geometry)
colour_swatch = ColourSwatch(SwatchColor=RGB(249, 131, 217))
colour_swatch_2 = ColourSwatch(SwatchColor=RGB(147, 255, 193))
custom_preview = CustomPreview(Geometry=line_2, Material=colour_swatch)
custom_preview_2 = CustomPreview(Geometry=line_3, Material=colour_swatch)
custom_preview_3 = CustomPreview(Geometry=line_4, Material=colour_swatch_2)
custom_preview_4 = CustomPreview(Geometry=line, Material=colour_swatch_2)
panel_19 = Panel("river")
path_3 = FilePath("H:\UCL Master\Skill Submission\Skills Module 3 - DATA MINING THE CITY\Scrapped Data\flickr_photos_river.csv")
file_3 = ReadFile(File=path_3, PerLineParse=True)
panel_20 = Panel(file_3)
cull_i_3 = CullIndex(List=file_3, Indices="0", Wrap=True)
split_3 = TextSplit(Text=cull_i_3, Separators=",")
panel_21 = Panel(split_3)
item_7 = ListItem(List=split_3, Index="0", Wrap=True)  # -> Item, Item1

item_8 = ListItem(List=split_3, Index="3", Wrap=True)  # -> Item, Item1
panel_22 = Panel(item_8.Item)

panel_23 = Panel(item_7.Item)
item_9 = ListItem(List=split_3, Index="3", Wrap=True)  # -> Item, Item1
panel_24 = Panel(item_9.Item)
panel_25 = Panel(item_7.Item1)
ddtoxy_3 = DecimalDegreesToXY(Latitude=item_7.Item, Longitude=item_7.Item1)  # -> XyPoint, Transform
dom_9 = ConstructDomain(DomainStart=Slider(0, range=0..1000), DomainEnd=Slider(455, range=0..1000))
dom_10 = ConstructDomain(DomainStart=Slider(0, range=0..1000), DomainEnd=Slider(30, range=0..1000))
panel_26 = Panel(ddtoxy_3.XyPoint)
remap_5 = RemapNumbers(Value=item_8.Item, Source=dom_9, Target=dom_10)  # -> Mapped, Clipped
dom_11 = ConstructDomain(DomainStart=Slider(46, range=0..1000), DomainEnd=Slider(413, range=0..1000))
dom_12 = ConstructDomain(DomainStart=Slider(156, range=0..1000), DomainEnd=Slider(193, range=0..1000))
unit_z_5 = UnitZ(Factor=remap_5.Mapped)
remap_6 = RemapNumbers(Value=item_9.Item, Source=dom_11, Target=dom_12)  # -> Mapped, Clipped
panel_27 = Panel(remap_6.Mapped)
unit_z_6 = UnitZ(Factor=remap_6.Mapped)
move_5 = Move(Geometry=ddtoxy_3.XyPoint, Motion=unit_z_5)  # -> Geometry, Transform
delaunay_mesh_3 = DelaunayMesh(Points=flatten(move_5.Geometry), Plane=PlaneXY(0, 0, 0))
move_6 = Move(Geometry=ddtoxy_3.XyPoint, Motion=unit_z_6)  # -> Geometry, Transform
mesh_edges_3 = MeshEdges(Mesh=delaunay_mesh_3)  # -> NakedEdges, InteriorEdges, NonManifoldEdges
line_5 = Line(StartPoint=ddtoxy_3.XyPoint, EndPoint=move_6.Geometry)
line_6 = Line(StartPoint=ddtoxy_3.XyPoint, EndPoint=move_5.Geometry)
colour_swatch_3 = ColourSwatch(SwatchColor=RGB(98, 129, 251))
custom_preview_5 = CustomPreview(Geometry=line_6, Material=colour_swatch_3)
custom_preview_6 = CustomPreview(Geometry=line_5, Material=colour_swatch_3)

# ----
# IMPORT AND FILTER OSM
# Field values of OSM are here:
# https://wiki.openstreetmap.org/wiki/Map_features
# you can test example values here:
# https://www.openstreetmap.org/node/6429327326
filterfiields = Panel("natural")  # disabled
filterfieldvalue = Panel("natural,tree")  # disabled
panel_28 = Panel("addr:postcode,SE1 7ND")  # disabled
panel_29 = Panel("amenity,cafe")  # disabled
path_4 = FilePath("H:\UCL Master\Skill\PervasiveUrbanism_24-25-main\Skills 2 - Day 2 Datavis Grasshopper and Pointclouds\2 Gridsampling, Principle\map (1).osm")  # disabled
importosm = ImportOSM(Boundary=<geometry referenced from the Rhino model>, OSMDataLocation=path_4, Clipped=True)  # -> Extents, Fields, Values, FeatureGeometry, Buildings; disabled

flatten_tree = FlattenTree(Tree=importosm.FeatureGeometry, Path="{0}")  # disabled
panel_30 = Panel(importosm.Values)  # disabled
split_4 = TextSplit(Text="51.5200220325861, -0.002001543935647126", Separators=",")
geo = Geometry(flatten_tree)  # disabled
panel_31 = Panel(split_4)
item_10 = ListItem(List=split_4, Index=0, Wrap=True)  # -> Item, Item1
file_path = FilePath("H:\UCL Master\Skill\PervasiveUrbanism_24-25-main\Skills 2 - Day 2 Datavis Grasshopper and Pointclouds\2 Gridsampling, Principle\map(2).osm")  # disabled
file_path_2 = FilePath("H:\UCL Master\Skill\PervasiveUrbanism_24-25-main\Skills 2 - Day 2 Datavis Grasshopper and Pointclouds\2 Gridsampling, Principle\map(2).osm")  # disabled
panel_32 = Panel(item_10.Item1)
import_osm = ImportOSM(Boundary=<geometry referenced from the Rhino model>, OSMDataLocation=file_path_2, Clipped=True)  # -> Extents, Fields, Values, FeatureGeometry, Buildings; disabled
panel_33 = Panel(item_10.Item)
import_osm_2 = ImportOSM(Boundary=<geometry referenced from the Rhino model>, OSMDataLocation=file_path, Clipped=True)  # -> Extents, Fields, Values, FeatureGeometry, Buildings; disabled
file_path_3 = FilePath("H:\UCL Master\Skill\PervasiveUrbanism_24-25-main\Skills 2 - Day 2 Datavis Grasshopper and Pointclouds\2 Gridsampling, Principle\map(2).osm")  # disabled
seteap = SetEarthAnchorPoint(SetEAP=Toggle(True), Latitude=item_10.Item, Longitude=item_10.Item1)
import_osm_3 = ImportOSM(Boundary=<geometry referenced from the Rhino model>, OSMDataLocation=file_path_3, Clipped=True)  # -> Extents, Fields, Values, FeatureGeometry, Buildings; disabled
flatten_tree_2 = FlattenTree(Tree=import_osm_2.Buildings, Path="{0}")  # disabled
flatten_tree_3 = FlattenTree(Tree=import_osm.Buildings, Path="{0}")  # disabled
panel_34 = Panel(import_osm.FeatureGeometry)  # disabled
panel_35 = Panel(seteap)
geo_2 = Geometry(flatten_tree_2)  # disabled
geo_3 = Geometry(flatten_tree_3)  # disabled
flatten_tree_4 = FlattenTree(Tree=import_osm_3.Buildings, Path="{0}")  # disabled
file_path_4 = FilePath("H:\UCL Master\Skill\PervasiveUrbanism_24-25-main\Skills 2 - Day 2 Datavis Grasshopper and Pointclouds\2 Gridsampling, Principle\map(2).osm")  # disabled
import_osm_4 = ImportOSM(Boundary=<geometry referenced from the Rhino model>, OSMDataLocation=file_path_4, Clipped=True)  # -> Extents, Fields, Values, FeatureGeometry, Buildings; disabled
geo_4 = Geometry(flatten_tree_4)  # disabled
flatten_tree_5 = FlattenTree(Tree=import_osm_4.Buildings, Path="{0}")  # disabled
geo_5 = Geometry(flatten_tree_5)  # disabled
geometry = Geometry([geo_3, geo, geo_2, geo_5, geo_4])  # disabled

panel_36 = Panel("sunset")
path_5 = FilePath("H:\UCL Master\Skill Submission\Skills Module 3 - DATA MINING THE CITY\Scrapped Data\flickr_photos_sunset.csv")
file_4 = ReadFile(File=path_5, PerLineParse=True)
panel_37 = Panel(file_4)
cull_i_4 = CullIndex(List=file_4, Indices="0", Wrap=True)
split_5 = TextSplit(Text=cull_i_4, Separators=",")
panel_38 = Panel(split_5)
item_11 = ListItem(List=split_5, Index="0", Wrap=True)  # -> Item, Item1
panel_39 = Panel(item_11.Item)
item_12 = ListItem(List=split_5, Index="3", Wrap=True)  # -> Item, Item1
panel_40 = Panel(item_12.Item)
panel_41 = Panel(item_11.Item1)
ddtoxy_4 = DecimalDegreesToXY(Latitude=item_11.Item, Longitude=item_11.Item1)  # -> XyPoint, Transform
dom_13 = ConstructDomain(DomainStart=Slider(0, range=0..1000), DomainEnd=Slider(455, range=0..1000))
dom_14 = ConstructDomain(DomainStart=Slider(0, range=0..1000), DomainEnd=Slider(30, range=0..1000))
panel_42 = Panel(ddtoxy_4.XyPoint)
dom_15 = ConstructDomain(DomainStart=Slider(46, range=0..1000), DomainEnd=Slider(413, range=0..1000))
dom_16 = ConstructDomain(DomainStart=Slider(156, range=0..1000), DomainEnd=Slider(193, range=0..1000))
remap_7 = RemapNumbers(Value=item_12.Item, Source=dom_15, Target=dom_16)  # -> Mapped, Clipped
panel_43 = Panel(remap_7.Mapped)
unit_z_7 = UnitZ(Factor=remap_7.Mapped)
move_7 = Move(Geometry=ddtoxy_4.XyPoint, Motion=unit_z_7)  # -> Geometry, Transform
line_7 = Line(StartPoint=ddtoxy_4.XyPoint, EndPoint=move_7.Geometry)
colour_swatch_4 = ColourSwatch(SwatchColor=RGB(155, 109, 254))
custom_preview_7 = CustomPreview(Geometry=line_7, Material=colour_swatch_4)

point = Point([move_7.Geometry, move_4.Geometry, move_3.Geometry, move_6.Geometry])

item_13 = ListItem(List=split_5, Index="3", Wrap=True)  # -> Item, Item1
panel_44 = Panel(item_13.Item)

remap_8 = RemapNumbers(Value=item_13.Item, Source=dom_13, Target=dom_14)  # -> Mapped, Clipped
unit_z_8 = UnitZ(Factor=remap_8.Mapped)
move_8 = Move(Geometry=ddtoxy_4.XyPoint, Motion=unit_z_8)  # -> Geometry, Transform
delaunay_mesh_4 = DelaunayMesh(Points=flatten(move_8.Geometry), Plane=PlaneXY(0, 0, 0))
mesh_edges_4 = MeshEdges(Mesh=delaunay_mesh_4)  # -> NakedEdges, InteriorEdges, NonManifoldEdges
line_8 = Line(StartPoint=ddtoxy_4.XyPoint, EndPoint=move_8.Geometry)
custom_preview_8 = CustomPreview(Geometry=line_8, Material=colour_swatch_4)
