# Grasshopper definition Wavemap.gh (Grasshopper 1.0.7)
# plug-ins: Human, Heron

panel = Panel("Sky")
panel_2 = Panel("Sunset")
panel_3 = Panel("Cloud")
panel_4 = Panel("River")
path = FilePath("H:\UCL Master\Skill Submission\Skills Module 3 - DATA MINING THE CITY\flickr_photos_sky.csv")
path_2 = FilePath("H:\UCL Master\Skill Submission\Skills Module 3 - DATA MINING THE CITY\flickr_photos_sunset.csv")
path_3 = FilePath("H:\UCL Master\Skill Submission\Skills Module 3 - DATA MINING THE CITY\flickr_photos_cloud.csv")
path_4 = FilePath("H:\UCL Master\Skill Submission\Skills Module 3 - DATA MINING THE CITY\flickr_photos_river.csv")
file = ReadFile(File=path, PerLineParse=True)
file_2 = ReadFile(File=path_2, PerLineParse=True)
file_3 = ReadFile(File=path_3, PerLineParse=True)
file_4 = ReadFile(File=path_4, PerLineParse=True)
cull_i = CullIndex(List=file, Indices="0", Wrap=True)
cull_i_2 = CullIndex(List=file_2, Indices="0", Wrap=True)
cull_i_3 = CullIndex(List=file_3, Indices="0", Wrap=True)
cull_i_4 = CullIndex(List=file_4, Indices="0", Wrap=True)
split = TextSplit(Text=cull_i, Separators=",")
split_2 = TextSplit(Text=cull_i_2, Separators=",")
split_3 = TextSplit(Text=cull_i_3, Separators=",")
split_4 = TextSplit(Text=cull_i_4, Separators=",")
panel_5 = Panel(split)
panel_6 = Panel(split_2)
panel_7 = Panel(split_3)
panel_8 = Panel(split_4)
item = ListItem(List=split, Index="0", Wrap=True)  # -> Item, Item1
item_2 = ListItem(List=split_2, Index="0", Wrap=True)  # -> Item, Item1
item_3 = ListItem(List=split_3, Index="0", Wrap=True)  # -> Item, Item1
item_4 = ListItem(List=split_4, Index="0", Wrap=True)  # -> Item, Item1
panel_9 = Panel(item.Item1)
panel_10 = Panel(item.Item)
panel_11 = Panel(item_2.Item1)
panel_12 = Panel(item_2.Item)
panel_13 = Panel(item_3.Item1)
panel_14 = Panel(item_3.Item)
panel_15 = Panel(item_4.Item1)
panel_16 = Panel(item_4.Item)
ddtoxy = DecimalDegreesToXY(Latitude=item.Item, Longitude=item.Item1)  # -> XyPoint, Transform
ddtoxy_2 = DecimalDegreesToXY(Latitude=item_2.Item, Longitude=item_2.Item1)  # -> XyPoint, Transform
ddtoxy_3 = DecimalDegreesToXY(Latitude=item_3.Item, Longitude=item_3.Item1)  # -> XyPoint, Transform
ddtoxy_4 = DecimalDegreesToXY(Latitude=item_4.Item, Longitude=item_4.Item1)  # -> XyPoint, Transform
geo = Geometry([ddtoxy.XyPoint, ddtoxy_2.XyPoint, ddtoxy_4.XyPoint, ddtoxy_3.XyPoint])

x = Panel("40")
y = Panel("36")
sqgrid = Square(Plane=PlaneXY(0, 0, 0), Size=Slider(50, range=0..1000), ExtentX=x, ExtentY=y)  # -> flatten(Cells), Points

area = Area(Geometry=sqgrid.Cells)  # -> Area, Centroid

negative = Negative(Value=Slider(650, range=0..10000))
negative_2 = Negative(Value=Slider(1000, range=0..10000))
unit_x = UnitX(Factor=negative_2)
unit_y = UnitY(Factor=negative)
move = Move(Geometry=sqgrid.Cells, Motion=unit_x)  # -> Geometry, Transform
move_2 = Move(Geometry=move.Geometry, Motion=unit_y)  # -> Geometry, Transform

curve = Curve(<curve referenced from the Rhino model>)  # disabled

# ----
# Field values of OSM are here:
# https://wiki.openstreetmap.org/wiki/Map_features
# you can test example values here:
# https://www.openstreetmap.org/node/6429327326
panel_17 = Panel("amenity,cafe")  # disabled
# IMPORT AND FILTER OSM
filterfiields = Panel("natural")  # disabled
filterfieldvalue = Panel("natural,tree")  # disabled
panel_18 = Panel("addr:postcode,SE1 7ND")  # disabled
path_5 = FilePath("H:\UCL Master\Skill Submission\Skills Module 3 - DATA MINING THE CITY\map.osm")  # disabled
importosm = ImportOSM(Boundary=curve, OSMDataLocation=path_5, Clipped=True)  # -> Extents, Fields, Values, FeatureGeometry, Buildings; disabled

area_2 = Area(Geometry=move_2.Geometry)  # -> Area, Centroid
split_5 = TextSplit(Text="51.53757588854593, -0.12496321628604884", Separators=",")
merge = Merge(Data1=geo, Data2=area_2.Centroid)
pt = Point(merge)
panel_19 = Panel(split_5)
item_5 = ListItem(List=split_5, Index=0, Wrap=True)  # -> Item, Item1
incurves = PointInCurves(Point=pt, Curves=move_2.Geometry)  # -> Relationship, Index, Point
unit_z = UnitZ(Factor=incurves.Index)
panel_20 = Panel(item_5.Item1)
move_3 = Move(Geometry=geo, Motion=unit_z)  # -> Geometry, Transform
panel_21 = Panel(importosm.Buildings)  # disabled
panel_22 = Panel(item_5.Item)
python = GhPythonScript(numbers=incurves.Index)  # -> out, simplify(a); inputs numbers: list of Int32
# ---------- python: Python ----------
import ghpythonlib.treehelpers as th

index_dict = {}
for index, number in enumerate(numbers):
    if number not in index_dict:
        index_dict[number] = []
    index_dict[number].append(index)

# Ensure all numbers from 0 to max(numbers) are included
max_number = max(numbers)
sorted_index_lists = [index_dict.get(i, []) for i in range(max_number + 1)]

from pprint import pprint
pprint(sorted_index_lists)
pprint(index_dict)





a = th.list_to_tree(sorted_index_lists)
# ---------- end python ----------
line = Line(StartPoint=geo, EndPoint=move_3.Geometry)
seteap = SetEarthAnchorPoint(SetEAP=Toggle(True), Latitude=item_5.Item, Longitude=item_5.Item1)
tstat = TreeStatistics(Tree=python.a)  # -> Paths, Length, Count
length = Length(Curve=line)
panel_23 = Panel(seteap)

# ---- group: Surface Grid
# Add contrast by "streching" the numbers
bnd = Bounds(Numbers=tstat.Length)
dom = ConstructDomain(DomainStart="0", DomainEnd="2000")
remap = RemapNumbers(Value=tstat.Length, Source=bnd, Target=dom)  # -> Mapped, Clipped
Z = UnitZ(Factor=remap.Mapped)
move_4 = Move(Geometry=area_2.Centroid, Motion=Z)  # -> Geometry, Transform
srfgrid = SurfaceFromPoints(Points=move_4.Geometry, UCount=x, Interpolate=False)

# ----
bnd_2 = Bounds(Numbers=flatten(length))
panel_24 = Panel(python.a)
dedomain = DeconstructDomain(Domain=bnd_2)  # -> Start, End
gradient = Gradient(
    LowerLimit=dedomain.Start,
    UpperLimit=dedomain.End,
    Parameter=flatten(length),
    stops=[0: RGB(75, 107, 169), 0.217: RGB(173, 203, 249), 0.425: RGB(128, 255, 255), 0.757: RGB(255, 128, 255), 1: RGB(255, 0, 255)])
panel_25 = Panel(move_4.Geometry)
preview = CustomPreview(Geometry=flatten(line), Material=gradient)

# ---- group: Graphics & Baking
contour = Contour(Shape=srfgrid, Point=Point(0, 0, 0), Direction=Vector(0, 0, 1), Distance=Slider(3, range=0..100))
eval = EvaluateCurve(Curve=contour, Parameter=0)  # -> Point, Tangent, Angle
pdecon = Deconstruct(Point=eval.Point)  # -> XComponent, YComponent, ZComponent
bnd_3 = Bounds(Numbers=flatten(pdecon.ZComponent))
dedomain_2 = DeconstructDomain(Domain=bnd_3)  # -> Start, End
gradient_2 = Gradient(
    LowerLimit=dedomain_2.Start,
    UpperLimit=dedomain_2.End,
    Parameter=flatten(pdecon.ZComponent),
    stops=[0: RGB(100, 149, 237), 0.000319: RGB(128, 128, 255), 0.114: RGB(0, 255, 255), 0.451: RGB(255, 128, 255), 0.747: RGB(192, 0, 192)])
preview_2 = CustomPreview(Geometry=flatten(contour), Material=gradient_2)
createatts = CreateAttributes(LayerName="Contours", Color=gradient_2, enableFullPath=False)
bake = BakeGeometry(Bake=Button(), Geometry=flatten(contour), Attributes=createatts, DeleteOldBakes=False, PreserveTrees=False)

# ----
createatts_2 = CreateAttributes(Color=gradient, enableFullPath=False)
bake_2 = BakeGeometry(Bake=Button(), Geometry=flatten(line), Attributes=createatts_2, DeleteOldBakes=False, PreserveTrees=False)
panel_26 = Panel(pdecon.ZComponent)
